# Dynamo graph circus-maker.dyn (Dynamo 1.3.3.4651)

code_block = CodeBlock { 0..21..2; 0..11..2; 0..11..2; 1; }
lastItem = List.LastItem(code_block.out2@L3)
randomList = Math.RandomList(code_block.out3)
add = lastItem + randomList
byCoordinates = Point.ByCoordinates(x=code_block.out0, y=code_block.out1, z=add, lacing=CrossProduct)
transpose = List.Transpose(byCoordinates)
boolean = BoolSelector(false)
byPoints = PolyCurve.ByPoints(points=transpose, connectLastToFirst=boolean)
