# Dynamo graph Emboss.5.01.dyn (Dynamo 1.3.3.4651)

file_path = Filename(".\rgbb.gif")
fromPath = FileObject(file_path)  # "File.FromPath"
readFromFile = Image.ReadFromFile(fromPath)
watch_image = WatchImageCore(readFromFile)

# group: export to txt
file_path_2 = Filename(".\expo.txt")
string_from_array = FromArray()  # unwired: arg0
writeText = File.WriteText(file_path_2, string_from_array)

code_block = CodeBlock { 0..8; }
code_block_2 = CodeBlock { 0..20..#9; }
byCoordinates = Point.ByCoordinates(x=code_block, y=code_block, z=code_block_2, lacing=CrossProduct)
byPoints = Topography.ByPoints(byCoordinates)
code_block_3 = CodeBlock { 9; }
pixels = Image.Pixels(image=readFromFile, xSamples=code_block_3, ySamples=code_block_3)
integer_slider = IntegerSlider(0, range=0..8 step 1)
getItemAtIndex = List.GetItemAtIndex(list=pixels, index=integer_slider)
