# Dynamo graph Emboss.5.04.dyn (Dynamo 2.0.1.5055)

file_path = Filename(".\dial.gif")  # graph input
fromPath = FileObject(path=file_path)  # "File.FromPath"
readFromFile = Image.ReadFromFile(file=fromPath)
watch_image = WatchImageCore(image=readFromFile)
dimensions = Image.Dimensions(image=readFromFile)
pixels = Image.Pixels(image=readFromFile, xSamples=dimensions.width, ySamples=dimensions.height, lacing=CrossProduct)
transpose = List.Transpose(lists=pixels@L1, lacing=Shortest)
red = Color.Red(color=transpose@L1, lacing=Shortest)
green = Color.Green(color=transpose@L1)
add = red + green
blue = Color.Blue(color=transpose@L1)
add_2 = add + blue
code_block = CodeBlock { 7.65; }
div = add_2 / code_block
