# Dynamo graph Revit-File-Upgrader-v0.8.dyn (Dynamo 1.3.3.4651)

# group: Choose folder to be upgraded, then click Run...
# note: Based on the Dynamo bulk family upgrade process by John Pierson http://sixtysecondrevit.com/2016-10-26-bulk-upgrade-revit-files-with-dynamobim/
# I replaced Document.BackgroundOpen with Applications.OpenDocumentFile, and Document.Close with Applications.CloseDocument.
directory_path = Directory("C:\aaa\programming\Dynamo\dynamo-revitup\v2017 coursefiles\outer")

fromPath = DirectoryObject(directory_path)  # "Directory.FromPath"
contents = Directory.Contents(fromPath)
code_block = CodeBlock { true; }
code_block_2 = CodeBlock { true; }

# group: Rhythm
openDocumentFile = Rhythm.Revit.Application.Applications.OpenDocumentFile(contents, code_block, code_block)
closeDocument = Rhythm.Revit.Application.Applications.CloseDocument(openDocumentFile, code_block_2)
