# Dynamo graph Revit-File-Upgrader-v0.9.01.dyn (Dynamo 1.3.3.4651)

# group: Choose folder click Run...
directory_path = Directory("C:\Users\pdx9\Desktop\outer")

fromPath = DirectoryObject(directory_path)  # "Directory.FromPath"
contents = Directory.Contents()  # unwired: arg0

# group: rhythm- open save close
code_block = CodeBlock { true; }
openDocumentFile = Rhythm.Revit.Application.Applications.OpenDocumentFile(contents.out0, code_block, code_block)
code_block_2 = CodeBlock { true; }
closeDocument = Rhythm.Revit.Application.Applications.CloseDocument(openDocumentFile, code_block_2)

fromPath_2 = DirectoryObject(contents.out1)  # "Directory.FromPath"
contents_2 = Directory.Contents(fromPath_2)

# group: rhythm- open save close
code_block_3 = CodeBlock { true; }
openDocumentFile_2 = Rhythm.Revit.Application.Applications.OpenDocumentFile(contents_2, code_block_3, code_block_3)
code_block_4 = CodeBlock { true; }
closeDocument_2 = Rhythm.Revit.Application.Applications.CloseDocument(openDocumentFile_2, code_block_4)
