# Dynamo graph 2_03_ReadFloota_CSV_end.dyn (Dynamo 1.3.3.4651)

# group: Read Excel Level Data (Lynda)
file_path = Filename("..\Excel\ProjectStartup.xlsx")
fromPath = FileObject(file_path)  # "File.FromPath"
code_block = CodeBlock { "Levels"; }
readFromFile = Excel.ReadFromFile(file=fromPath, sheetName=code_block)
firstItem = List.FirstItem(readFromFile)
restOfItems = List.RestOfItems(readFromFile)

# group: Create Revit Levels
transpose = List.Transpose(restOfItems)
code_block_2 = CodeBlock { 1; 0; }
getItemAtIndex = List.GetItemAtIndex(list=transpose, index=code_block_2.out0)
getItemAtIndex_2 = List.GetItemAtIndex(list=transpose, index=code_block_2.out1)
byElevationAndName = Level.ByElevationAndName(getItemAtIndex, getItemAtIndex_2)

# group: Read Excel Floor Plan Data
code_block_3 = CodeBlock { "Floor Plans"; }
readFromFile_2 = Excel.ReadFromFile(file=fromPath, sheetName=code_block_3)
firstItem_2 = List.FirstItem(readFromFile_2)
restOfItems_2 = List.RestOfItems(readFromFile_2)
transpose_2 = List.Transpose(restOfItems_2)

# group: Read CSV data
file_path_2 = Filename("..\Excel\ProjectStartup.csv")
fromPath_2 = FileObject(file_path_2)  # "File.FromPath"
readFromFile_3 = CSV.ReadFromFile(fromPath_2)
transpose_3 = List.Transpose(readFromFile_3@L3)
